# Grasshopper definition MeshSync - Export Example.gh (Grasshopper 1.0.7)
# plug-ins: Python

number_slider = Slider(2.95, range=0..10)
# MeshSync - Export Example
series = Series(Start=0, Step=1, Count=10)
sin = Sine(Value=series)
pt = ConstructPoint(XCoordinate=series, YCoordinate=expr("-x", sin), ZCoordinate=number_slider)
pt_2 = ConstructPoint(XCoordinate=series, YCoordinate=sin, ZCoordinate=expr("x*2", number_slider))
pt_3 = ConstructPoint(XCoordinate=series, YCoordinate=sin, ZCoordinate=0)
intcrv = Interpolate(Vertices=pt_3, Degree=3, Periodic=False, KnotStyle=1)  # -> Curve, Length, Domain
intcrv_2 = Interpolate(Vertices=pt, Degree=3, Periodic=False, KnotStyle=1)  # -> Curve, Length, Domain
intcrv_3 = Interpolate(Vertices=pt_2, Degree=3, Periodic=False, KnotStyle=1)  # -> Curve, Length, Domain
loft = Loft(
    Curves=[intcrv.Curve, intcrv_2.Curve, intcrv_3.Curve],
    Options={Adjust=False, Closed=False, LoftEnds=0, LoftSimp=0, LoftType=0, Rebuild=10, Refit=0.01})
mesh_uv = MeshSurface(Surface=loft, UCount=Slider(20, range=0..100), VCount=Slider(21, range=0..100), Overhang=True, Equalize=False)
demesh = DeconstructMesh(Mesh=mesh_uv)  # -> Vertices, Faces, Colours, Normals
pdecon = Deconstruct(Point=demesh.Vertices)  # -> XComponent, YComponent, ZComponent
sin_2 = Sine(Value=pdecon.XComponent)
cos = Cosine(Value=pdecon.ZComponent)
addition = Addition(A=sin_2, B=cos)
multiplication = Multiplication(A=sin_2, B=cos)
bnd = Bounds(Numbers=addition)
bnd_2 = Bounds(Numbers=multiplication)
remap = RemapNumbers(Value=addition, Source=bnd, Target=Domain(0, 1))  # -> Mapped, Clipped
remap_2 = RemapNumbers(Value=multiplication, Source=bnd_2, Target=Domain(0, 1))  # -> Mapped, Clipped
path = FilePath()
meshsync_export = MeshSyncExport(Export=Button(), Path=path, Mesh=mesh_uv, Weight=remap.Mapped)
