# Grasshopper definition MeshSync - Import Example.gh (Grasshopper 1.0.7)
# plug-ins: Python

# ---- group: On / Off
# MeshSync - Import Example
toggle = BooleanToggle(True)

# ----
path = FilePath()
meshsync_import_advanced = MeshSyncImportAdvanced(Import=toggle, Path=path)  # -> Mesh, Verts, Edges, Faces, Weight, VertNeigh, FaceNeigh
meshsync_import = MeshSyncImport(Import=toggle, Path=path)  # -> Mesh, Verts, Edges, Faces
meshsync_import_simple = MeshSyncImportSimple(Import=toggle, Path=path)

# ---- group: Vertex Neighbors
number_slider = Slider(100, range=0..100)
branch = TreeBranch(Tree=meshsync_import_advanced.VertNeigh, Path=number_slider, MaintainPaths=True)
item = ListItem(List=meshsync_import_advanced.Verts, Index=branch, Wrap=True)
item_2 = ListItem(List=meshsync_import_advanced.Verts, Index=number_slider, Wrap=True)
ln = Line(StartPoint=item, EndPoint=item_2)

# ---- group: Vertex Weight
item_3 = ListItem(List=meshsync_import_advanced.Weight, Index=Slider(1, range=0..10), Wrap=True)
gradient = Gradient(
    LowerLimit=0,
    UpperLimit=1,
    Parameter=flatten(item_3),
    stops=[0: RGB(234, 38, 0), 0.25: RGB(234, 126, 0), 0.5: RGB(254, 244, 84), 0.75: RGB(173, 203, 249), 1: RGB(75, 107, 169)])

# ---- group: Faces
item_4 = ListItem(List=meshsync_import_advanced.Verts, Index=meshsync_import_advanced.Faces, Wrap=True)
pline = PolyLine(Vertices=item_4, Closed=True)
boundary = BoundarySurfaces(Edges=pline)  # -> flatten(Surfaces)

# ---- group: Face Neighbors
number_slider_2 = Slider(11, range=0..100)
branch_2 = TreeBranch(Tree=meshsync_import_advanced.FaceNeigh, Path=number_slider_2, MaintainPaths=True)
item_5 = ListItem(List=flatten(boundary), Index=branch_2, Wrap=True)
item_6 = ListItem(List=boundary, Index=number_slider_2, Wrap=True)
area = Area(Geometry=item_5)  # -> Area, Centroid
area_2 = Area(Geometry=item_6)  # -> Area, Centroid
ln_2 = Line(StartPoint=area.Centroid, EndPoint=area_2.Centroid)

# ---- group: Edges
item_7 = ListItem(List=meshsync_import_advanced.Verts, Index=meshsync_import_advanced.Edges, Wrap=True)
pline_2 = PolyLine(Vertices=item_7, Closed=False)

# ----
mcol = MeshColours(Mesh=meshsync_import_advanced.Mesh, Colours=gradient)
